# Dynamo graph Ocupação de eletrocalha_script.dyn (Dynamo 2.13.1.3887)

# note: área util bandeja
python_script = Python()  # IronPython2; unwired: IN[0]
# ---------- python_script.python (51 lines) ----------
# Importando as bibliotecas necessárias
import clr
clr.AddReference("RevitServices")
from RevitServices.Persistence import DocumentManager
from RevitServices.Transactions import TransactionManager

clr.AddReference("RevitAPI")
from Autodesk.Revit.DB import FilteredElementCollector, BuiltInCategory, ElementCategoryFilter

# Obtendo o documento ativo
doc = DocumentManager.Instance.CurrentDBDocument

# Criando um coletor para filtrar elementos da categoria de bandejas de cabos
categoria_bandeja = BuiltInCategory.OST_CableTray
filtro_categoria = ElementCategoryFilter(categoria_bandeja)
colecao_elementos = FilteredElementCollector(doc).WherePasses(filtro_categoria).WhereElementIsNotElementType().ToElements()

# Inicializando uma lista para armazenar as informações dos elementos e seus cálculos de área útil
elementos_com_area_util = []

# Iniciando uma transação para editar os parâmetros dos elementos
TransactionManager.Instance.EnsureInTransaction(doc)

# Iterando sobre cada elemento para coletar, calcular e atualizar o parâmetro "Área útil"
for elemento in colecao_elementos:
    largura = None
    altura = None
    
    # Procurando exatamente os parâmetros "Largura" e "Altura" pelo nome
    for parametro in elemento.Parameters:
        nome_parametro = parametro.Definition.Name
        if nome_parametro == "Largura":
            largura = float(parametro.AsValueString())  # Convertendo para float para cálculos
        elif nome_parametro == "Altura":
            altura = float(parametro.AsValueString())
    
    # Calculando a "Área útil" se ambos os parâmetros forem encontrados
    if largura is not None and altura is not None:
        area_util = largura * altura * 0.2  # Multiplicando por 0,2 conforme instruído
        
        # Atribuindo o valor calculado ao parâmetro "Área útil"
        for parametro in elemento.Parameters:
            if parametro.Definition.Name == "Área útil":
                parametro.Set(area_util)
                elementos_com_area_util.append({"Elemento": elemento, "Área útil": area_util})  # Salvando o ID e área para referência

# Finalizando a transação
TransactionManager.Instance.TransactionTaskDone()

# Saída para confirmar os elementos processados e seus valores de "Área útil"
OUT = elementos_com_area_util
# ----------------------------------------
python_script_2 = Python()  # IronPython2; frozen; unwired: IN[0]
# ---------- python_script_2.python (116 lines) ----------
# Importando as bibliotecas necessárias
import clr
clr.AddReference("RevitServices")
from RevitServices.Persistence import DocumentManager
from RevitServices.Transactions import TransactionManager

clr.AddReference("RevitAPI")
from Autodesk.Revit.DB import FilteredElementCollector, BuiltInCategory, ElementCategoryFilter

# Obtendo o documento ativo
doc = DocumentManager.Instance.CurrentDBDocument

# Lista de tamanhos em ordem fixa, conforme solicitado
ordem_tamanhos = ["1,5mm²", "2,5mm²", "4,0mm²", "6,0mm²", "10,0mm²", "16,0mm²", "25,0mm²", 
                  "35,0mm²", "50,0mm²", "70,0mm²", "95,0mm²", "120,0mm²", "150,0mm²", "185,0mm²", "240,0mm²"]

# Lista dos nomes dos parâmetros a serem verificados, organizados por tamanho, com constantes associadas diretamente
parametros_por_tamanho = {
    "1,5mm²": {"parametros": ["1,5mm²_Fase A", "1,5mm²_Fase B", "1,5mm²_Fase C", "1,5mm²_Neutro", "1,5mm²_Retorno", "1,5mm²_Terra"], "constante": 18.1},
    "2,5mm²": {"parametros": ["2,5mm²_Fase A", "2,5mm²_Fase B", "2,5mm²_Fase C", "2,5mm²_Neutro", "2,5mm²_Retorno", "2,5mm²_Terra"], "constante": 32.17},
    "4,0mm²": {"parametros": ["4,0mm²_Fase A", "4,0mm²_Fase B", "4,0mm²_Fase C", "4,0mm²_Neutro", "4,0mm²_Retorno", "4,0mm²_Terra"], "constante": 38.48},
    "6,0mm²": {"parametros": ["6,0mm²_Fase A", "6,0mm²_Fase B", "6,0mm²_Fase C", "6,0mm²_Neutro", "6,0mm²_Terra"], "constante": 44.18},
    "10,0mm²": {"parametros": ["10,0mm²_Fase A", "10,0mm²_Fase B", "10,0mm²_Fase C", "10,0mm²_Neutro", "10,0mm²_Terra"], "constante": 88.24},
    "16,0mm²": {"parametros": ["16,0mm²_Fase A", "16,0mm²_Fase B", "16,0mm²_Fase C", "16,0mm²_Neutro", "16,0mm²_Terra"], "constante": 100.28},
    "25,0mm²": {"parametros": ["25,0mm²_Fase A", "25,0mm²_Fase B", "25,0mm²_Fase C", "25,0mm²_Neutro", "25,0mm²_Terra"], "constante": 120.76},
    "35,0mm²": {"parametros": ["35,0mm²_Fase A", "35,0mm²_Fase B", "35,0mm²_Fase C", "35,0mm²_Neutro", "35,0mm²_Terra"], "constante": 132.73},
    "50,0mm²": {"parametros": ["50,0mm²_Fase A", "50,0mm²_Fase B", "50,0mm²_Fase C", "50,0mm²_Neutro", "50,0mm²_Terra"], "constante": 176.71},
    "70,0mm²": {"parametros": ["70,0mm²_Fase A", "70,0mm²_Fase B", "70,0mm²_Fase C", "70,0mm²_Neutro", "70,0mm²_Terra"], "constante": 219.03},
    "95,0mm²": {"parametros": ["95,0mm²_Fase A", "95,0mm²_Fase B", "95,0mm²_Fase C", "95,0mm²_Neutro", "95,0mm²_Terra"], "constante": 271.71},
    "120,0mm²": {"parametros": ["120,0mm²_Fase A", "120,0mm²_Fase B", "120,0mm²_Fase C", "120,0mm²_Neutro", "120,0mm²_Terra"], "constante": 336.53},
    "150,0mm²": {"parametros": ["150,0mm²_Fase A", "150,0mm²_Fase B", "150,0mm²_Fase C", "150,0mm²_Neutro", "150,0mm²_Terra"], "constante": 419.08},
    "185,0mm²": {"parametros": ["185,0mm²_Fase A", "185,0mm²_Fase B", "185,0mm²_Fase C", "185,0mm²_Neutro", "185,0mm²_Terra"], "constante": 490.86},
    "240,0mm²": {"parametros": ["240,0mm²_Fase A", "240,0mm²_Fase B", "240,0mm²_Fase C", "240,0mm²_Neutro", "240,0mm²_Terra"], "constante": 629}
}

# Coletando apenas os elementos da categoria Bandeja de Cabos
categoria_bandeja = BuiltInCategory.OST_CableTray
filtro_categoria = ElementCategoryFilter(categoria_bandeja)
colecao_elementos = FilteredElementCollector(doc).WherePasses(filtro_categoria).WhereElementIsNotElementType().ToElements()

# Inicializando o contador para o parâmetro "Trecho"
contador_trecho = 1

# Inicializando uma lista para armazenar os dados de cada elemento com a quantidade de cabos por grupo
quantidade_por_elemento = []

# Iniciando uma transação para editar os parâmetros dos elementos
TransactionManager.Instance.EnsureInTransaction(doc)

# Iterando sobre cada elemento da categoria Bandeja de Cabos para verificar os parâmetros especificados e somar os valores por tamanho de cabo
for elemento in colecao_elementos:
    soma_total_multiplicada = 0  # Inicializando a soma total dos valores multiplicados
    quantidade_por_grupo = {}  # Dicionário para armazenar a quantidade de cabos por grupo com valores diferentes de zero, em ordem fixa

    # Iterar sobre cada grupo de tamanho de cabo, seguindo a ordem predefinida
    for tamanho in ordem_tamanhos:
        info = parametros_por_tamanho.get(tamanho, None)
        if info:
            parametros = info["parametros"]
            constante = info["constante"]
            soma_tamanho = 0  # Inicializando a soma para este tamanho de cabo

            # Iterar sobre cada parâmetro dentro do tamanho
            for nome_parametro in parametros:
                for parametro in elemento.Parameters:
                    if parametro is not None and parametro.Definition is not None:
                        if parametro.Definition.Name == nome_parametro:
                            # Tentativa de obter o valor do parâmetro como número
                            valor_parametro = parametro.AsDouble() or parametro.AsInteger() or 0
                            soma_tamanho += valor_parametro
            
            # Multiplicar a soma pela constante associada a esse tamanho de cabo
            resultado_multiplicado = soma_tamanho * constante
            soma_total_multiplicada += resultado_multiplicado

            # Armazenar a quantidade calculada para o grupo atual no dicionário do elemento, somente se maior que zero
            if soma_tamanho > 0:
                quantidade_por_grupo[tamanho] = soma_tamanho

    # Atribuir o valor total somado ao parâmetro "Ocupação cabos" do elemento
    for parametro in elemento.Parameters:
        if parametro.Definition.Name == "Ocupação cabos":
            parametro.Set(soma_total_multiplicada)

    # Construir a string para o parâmetro "Descrição ocupação" no formato solicitado com quantidade primeiro, ordenado por ordem_tamanhos
    descricao_ocupacao = "; ".join(["{} x {}".format(quantidade_por_grupo[tamanho], tamanho) for tamanho in ordem_tamanhos if tamanho in quantidade_por_grupo])

    # Atribuir a string ao parâmetro "Descrição ocupação"
    for parametro in elemento.Parameters:
        if parametro.Definition.Name == "Descrição ocupação":
            parametro.Set(descricao_ocupacao)

    # Atribuir o valor sequencial ao parâmetro "Trecho"
    for parametro in elemento.Parameters:
        if parametro.Definition.Name == "Trecho":
            parametro.Set(contador_trecho)
    
    # Ordenar quantidade_por_grupo com base em ordem_tamanhos e adicionar apenas os grupos com valor maior que zero
    quantidade_ordenada = {tamanho: quantidade_por_grupo[tamanho] for tamanho in ordem_tamanhos if tamanho in quantidade_por_grupo}

    # Adicionar os dados do elemento atual na lista de saída
    quantidade_por_elemento.append({
        "ElementoID": elemento.Id.ToString(),
        "Trecho": contador_trecho,
        "QuantidadePorGrupo": quantidade_ordenada,
        "Descrição ocupação": descricao_ocupacao
    })
    
    # Incrementar o contador de trecho
    contador_trecho += 1

# Finalizando a transação
TransactionManager.Instance.TransactionTaskDone()

# Saída com a quantidade de cabos por grupo separada por elemento e organizada em ordem fixa, excluindo valores zero
OUT = quantidade_por_elemento
# ----------------------------------------
python_script_3 = Python()  # IronPython2; frozen; unwired: IN[0]
# ---------- python_script_3.python (45 lines) ----------
# Importando as bibliotecas necessárias
import clr
clr.AddReference("RevitServices")
from RevitServices.Persistence import DocumentManager
from RevitServices.Transactions import TransactionManager

clr.AddReference("RevitAPI")
from Autodesk.Revit.DB import FilteredElementCollector, BuiltInCategory, ElementCategoryFilter

# Obtendo o documento ativo
doc = DocumentManager.Instance.CurrentDBDocument

# Criando um coletor para filtrar elementos da categoria de conduítes
categoria_conduite = BuiltInCategory.OST_Conduit
filtro_categoria = ElementCategoryFilter(categoria_conduite)
colecao_elementos = FilteredElementCollector(doc).WherePasses(filtro_categoria).WhereElementIsNotElementType().ToElements()

# Inicializando uma lista para armazenar as informações dos elementos e seus cálculos de área útil
elementos_com_area_util = []

# Iniciando uma transação para editar os parâmetros dos elementos
TransactionManager.Instance.EnsureInTransaction(doc)

# Iterando sobre cada elemento para coletar, calcular e atualizar o parâmetro "Área útil"
for elemento in colecao_elementos:
    # Procurando o parâmetro "Diâmetro interno" diretamente
    parametro_diametro_interno = elemento.LookupParameter("Diâmetro interno")
    if parametro_diametro_interno:
        # Convertendo o valor para float para cálculos
        diametro_interno = float(parametro_diametro_interno.AsValueString())
        
        # Calculando a "Área útil"
        area_util = (3.1415 * (diametro_interno ** 2)) / 4 * 0.4  # Cálculo da área útil multiplicado por 0,4
        
        # Atribuindo o valor calculado ao parâmetro "Área útil"
        parametro_area_util = elemento.LookupParameter("Área útil")
        if parametro_area_util:
            parametro_area_util.Set(area_util)
            elementos_com_area_util.append({"Elemento": elemento.Id.ToString(), "Área útil": area_util})  # Salvando o ID e área para referência

# Finalizando a transação
TransactionManager.Instance.TransactionTaskDone()

# Saída para confirmar os elementos processados e seus valores de "Área útil"
OUT = elementos_com_area_util
# ----------------------------------------
python_script_4 = Python()  # IronPython2; frozen; unwired: IN[0]
# ---------- python_script_4.python (115 lines) ----------
# Importando as bibliotecas necessárias
import clr
clr.AddReference("RevitServices")
from RevitServices.Persistence import DocumentManager
from RevitServices.Transactions import TransactionManager

clr.AddReference("RevitAPI")
from Autodesk.Revit.DB import FilteredElementCollector, BuiltInCategory, ElementCategoryFilter

# Obtendo o documento ativo
doc = DocumentManager.Instance.CurrentDBDocument

# Lista de tamanhos em ordem fixa, conforme solicitado
ordem_tamanhos = ["1,5mm²", "2,5mm²", "4,0mm²", "6,0mm²", "10,0mm²", "16,0mm²", "25,0mm²", 
                  "35,0mm²", "50,0mm²", "70,0mm²", "95,0mm²", "120,0mm²", "150,0mm²", "185,0mm²", "240,0mm²","cat6"]

# Lista dos nomes dos parâmetros a serem verificados, organizados por tamanho, com constantes associadas diretamente
parametros_por_tamanho = {
    "1,5mm²": {"parametros": ["1,5mm²_Fase A", "1,5mm²_Fase B", "1,5mm²_Fase C", "1,5mm²_Neutro", "1,5mm²_Retorno", "1,5mm²_Terra"], "constante": 18.1},
    "2,5mm²": {"parametros": ["2,5mm²_Fase A", "2,5mm²_Fase B", "2,5mm²_Fase C", "2,5mm²_Neutro", "2,5mm²_Retorno", "2,5mm²_Terra"], "constante": 32.17},
    "4,0mm²": {"parametros": ["4,0mm²_Fase A", "4,0mm²_Fase B", "4,0mm²_Fase C", "4,0mm²_Neutro", "4,0mm²_Retorno", "4,0mm²_Terra"], "constante": 38.48},
    "6,0mm²": {"parametros": ["6,0mm²_Fase A", "6,0mm²_Fase B", "6,0mm²_Fase C", "6,0mm²_Neutro", "6,0mm²_Terra"], "constante": 44.18},
    "10,0mm²": {"parametros": ["10,0mm²_Fase A", "10,0mm²_Fase B", "10,0mm²_Fase C", "10,0mm²_Neutro", "10,0mm²_Terra"], "constante": 88.24},
    "16,0mm²": {"parametros": ["16,0mm²_Fase A", "16,0mm²_Fase B", "16,0mm²_Fase C", "16,0mm²_Neutro", "16,0mm²_Terra"], "constante": 100.28},
    "25,0mm²": {"parametros": ["25,0mm²_Fase A", "25,0mm²_Fase B", "25,0mm²_Fase C", "25,0mm²_Neutro", "25,0mm²_Terra"], "constante": 120.76},
    "35,0mm²": {"parametros": ["35,0mm²_Fase A", "35,0mm²_Fase B", "35,0mm²_Fase C", "35,0mm²_Neutro", "35,0mm²_Terra"], "constante": 132.73},
    "50,0mm²": {"parametros": ["50,0mm²_Fase A", "50,0mm²_Fase B", "50,0mm²_Fase C", "50,0mm²_Neutro", "50,0mm²_Terra"], "constante": 176.71},
    "70,0mm²": {"parametros": ["70,0mm²_Fase A", "70,0mm²_Fase B", "70,0mm²_Fase C", "70,0mm²_Neutro", "70,0mm²_Terra"], "constante": 219.03},
    "95,0mm²": {"parametros": ["95,0mm²_Fase A", "95,0mm²_Fase B", "95,0mm²_Fase C", "95,0mm²_Neutro", "95,0mm²_Terra"], "constante": 271.71},
    "120,0mm²": {"parametros": ["120,0mm²_Fase A", "120,0mm²_Fase B", "120,0mm²_Fase C", "120,0mm²_Neutro", "120,0mm²_Terra"], "constante": 336.53},
    "150,0mm²": {"parametros": ["150,0mm²_Fase A", "150,0mm²_Fase B", "150,0mm²_Fase C", "150,0mm²_Neutro", "150,0mm²_Terra"], "constante": 419.08},
    "185,0mm²": {"parametros": ["185,0mm²_Fase A", "185,0mm²_Fase B", "185,0mm²_Fase C", "185,0mm²_Neutro", "185,0mm²_Terra"], "constante": 490.86},
    "240,0mm²": {"parametros": ["240,0mm²_Fase A", "240,0mm²_Fase B", "240,0mm²_Fase C", "240,0mm²_Neutro", "240,0mm²_Terra"], "constante": 629},
    "cat6": {"parametros": ["CABO-UTP 4P", "Cb-UTP 4P"], "constante":30.19}
}

# Coletando apenas os elementos da categoria Conduítes
categoria_conduite = BuiltInCategory.OST_Conduit
filtro_categoria = ElementCategoryFilter(categoria_conduite)
colecao_elementos = FilteredElementCollector(doc).WherePasses(filtro_categoria).WhereElementIsNotElementType().ToElements()

# Inicializando o contador para o parâmetro "Trecho"
contador_trecho = 1

# Inicializando uma lista para armazenar os dados de cada elemento com a quantidade de cabos por grupo
quantidade_por_elemento = []

# Iniciando uma transação para editar os parâmetros dos elementos
TransactionManager.Instance.EnsureInTransaction(doc)

# Iterando sobre cada elemento da categoria Conduítes para verificar os parâmetros especificados e somar os valores por tamanho de cabo
for elemento in colecao_elementos:
    soma_total_multiplicada = 0  # Inicializando a soma total dos valores multiplicados
    quantidade_por_grupo = {}  # Dicionário para armazenar a quantidade de cabos por grupo com valores diferentes de zero, em ordem fixa

    # Iterar sobre cada grupo de tamanho de cabo, seguindo a ordem predefinida
    for tamanho in ordem_tamanhos:
        info = parametros_por_tamanho.get(tamanho, None)
        if info:
            parametros = info["parametros"]
            constante = info["constante"]
            soma_tamanho = 0  # Inicializando a soma para este tamanho de cabo

            # Iterar sobre cada parâmetro dentro do tamanho
            for nome_parametro in parametros:
                parametro = elemento.LookupParameter(nome_parametro)
                if parametro:
                    valor_parametro = parametro.AsDouble() or parametro.AsInteger() or 0
                    soma_tamanho += valor_parametro
            
            # Multiplicar a soma pela constante associada a esse tamanho de cabo
            resultado_multiplicado = soma_tamanho * constante
            soma_total_multiplicada += resultado_multiplicado

            # Armazenar a quantidade calculada para o grupo atual no dicionário do elemento, somente se maior que zero
            if soma_tamanho > 0:
                quantidade_por_grupo[tamanho] = soma_tamanho

    # Atribuir o valor total somado ao parâmetro "Ocupação cabos" do elemento
    parametro_ocupacao = elemento.LookupParameter("Ocupação cabos")
    if parametro_ocupacao and parametro_ocupacao.AsDouble() != soma_total_multiplicada:
        parametro_ocupacao.Set(soma_total_multiplicada)

    # Construir a string para o parâmetro "Descrição ocupação" no formato solicitado com quantidade primeiro, ordenado por ordem_tamanhos
    descricao_ocupacao = "; ".join(["{} x {}".format(quantidade_por_grupo[tamanho], tamanho) for tamanho in ordem_tamanhos if tamanho in quantidade_por_grupo])

    # Atribuir a string ao parâmetro "Descrição ocupação"
    parametro_descricao = elemento.LookupParameter("Descrição ocupação")
    if parametro_descricao and parametro_descricao.AsString() != descricao_ocupacao:
        parametro_descricao.Set(descricao_ocupacao)

    # Atribuir o valor sequencial ao parâmetro "Trecho"
    parametro_trecho = elemento.LookupParameter("Trecho")
    if parametro_trecho and parametro_trecho.AsInteger() != contador_trecho:
        parametro_trecho.Set(contador_trecho)
    
    # Ordenar quantidade_por_grupo com base em ordem_tamanhos e adicionar apenas os grupos com valor maior que zero
    quantidade_ordenada = {tamanho: quantidade_por_grupo[tamanho] for tamanho in ordem_tamanhos if tamanho in quantidade_por_grupo}

    # Adicionar os dados do elemento atual na lista de saída
    quantidade_por_elemento.append({
        "ElementoID": elemento.Id.ToString(),
        "Trecho": contador_trecho,
        "QuantidadePorGrupo": quantidade_ordenada,
        "Descrição ocupação": descricao_ocupacao
    })
    
    # Incrementar o contador de trecho
    contador_trecho += 1

# Finalizando a transação
TransactionManager.Instance.TransactionTaskDone()

# Saída com a quantidade de cabos por grupo separada por elemento e organizada em ordem fixa, excluindo valores zero
OUT = quantidade_por_elemento
# ----------------------------------------
# note: área util coduite
python_script_5 = Python()  # IronPython2; frozen; unwired: IN[0]; same code as python_script_3
python_script_6 = Python()  # IronPython2; frozen; unwired: IN[0]
# ---------- python_script_6.python (144 lines) ----------
# Importando as bibliotecas necessárias
import clr
clr.AddReference("RevitServices")
from RevitServices.Persistence import DocumentManager
from RevitServices.Transactions import TransactionManager

clr.AddReference("RevitAPI")
from Autodesk.Revit.DB import FilteredElementCollector, BuiltInCategory, ElementCategoryFilter

# Adicionando referências para a interface gráfica
clr.AddReference("System.Windows.Forms")
clr.AddReference("System.Drawing")
from System.Windows.Forms import Form, ProgressBar, Label, Application, FormStartPosition
from System.Drawing import Color, Size, Point
import time

# Classe para a barra de progresso
class ProgressBarForm(Form):
    def __init__(self, max_value):
        self.Text = 'Processando Ocupação dos Cabos'
        self.Size = Size(400, 150)
        self.StartPosition = FormStartPosition.CenterScreen
        self.BackColor = Color.FromArgb(45, 45, 48)
        self.ForeColor = Color.White
        self.ShowIcon = False

        # Configuração da barra de progresso
        self.progressBar = ProgressBar()
        self.progressBar.Width = 350
        self.progressBar.Height = 30
        self.progressBar.Location = Point(20, 20)
        self.progressBar.Minimum = 0
        self.progressBar.Maximum = max_value
        self.progressBar.Value = 0

        # Configuração do rótulo
        self.progressLabel = Label()
        self.progressLabel.Width = 350
        self.progressLabel.Height = 20
        self.progressLabel.Location = Point(20, 60)
        self.progressLabel.Text = "Iniciando..."

        # Adiciona os controles ao formulário
        self.Controls.Add(self.progressBar)
        self.Controls.Add(self.progressLabel)

    def update_progress(self, value):
        # Ajuste para garantir que o valor final seja alcançado
        if value >= self.progressBar.Maximum:
            self.progressBar.Value = self.progressBar.Maximum
        else:
            self.progressBar.Value = value
        self.progressLabel.Text = "Ocupação do cabo {}/{}".format(value, self.progressBar.Maximum)
        Application.DoEvents()

        if value == self.progressBar.Maximum:
            self.progressLabel.Text = "Finalizado com sucesso."
            time.sleep(1)

# Obtendo o documento ativo
doc = DocumentManager.Instance.CurrentDBDocument

# Lista de tamanhos e parâmetros de acordo com o exemplo
ordem_tamanhos = ["1,5mm²", "2,5mm²", "4,0mm²", "6,0mm²", "10,0mm²", "16,0mm²", "25,0mm²", 
                  "35,0mm²", "50,0mm²", "70,0mm²", "95,0mm²", "120,0mm²", "150,0mm²", "185,0mm²", "240,0mm²","cat6"]

parametros_por_tamanho = {
    "1,5mm²": {"parametros": ["1,5mm²_Fase A", "1,5mm²_Fase B", "1,5mm²_Fase C", "1,5mm²_Neutro", "1,5mm²_Retorno", "1,5mm²_Terra"], "constante": 18.1},
    "2,5mm²": {"parametros": ["2,5mm²_Fase A", "2,5mm²_Fase B", "2,5mm²_Fase C", "2,5mm²_Neutro", "2,5mm²_Retorno", "2,5mm²_Terra"], "constante": 32.17},
    "4,0mm²": {"parametros": ["4,0mm²_Fase A", "4,0mm²_Fase B", "4,0mm²_Fase C", "4,0mm²_Neutro", "4,0mm²_Retorno", "4,0mm²_Terra"], "constante": 38.48},
    "6,0mm²": {"parametros": ["6,0mm²_Fase A", "6,0mm²_Fase B", "6,0mm²_Fase C", "6,0mm²_Neutro", "6,0mm²_Terra"], "constante": 44.18},
    "10,0mm²": {"parametros": ["10,0mm²_Fase A", "10,0mm²_Fase B", "10,0mm²_Fase C", "10,0mm²_Neutro", "10,0mm²_Terra"], "constante": 88.24},
    "16,0mm²": {"parametros": ["16,0mm²_Fase A", "16,0mm²_Fase B", "16,0mm²_Fase C", "16,0mm²_Neutro", "16,0mm²_Terra"], "constante": 100.28},
    "25,0mm²": {"parametros": ["25,0mm²_Fase A", "25,0mm²_Fase B", "25,0mm²_Fase C", "25,0mm²_Neutro", "25,0mm²_Terra"], "constante": 120.76},
    "35,0mm²": {"parametros": ["35,0mm²_Fase A", "35,0mm²_Fase B", "35,0mm²_Fase C", "35,0mm²_Neutro", "35,0mm²_Terra"], "constante": 132.73},
    "50,0mm²": {"parametros": ["50,0mm²_Fase A", "50,0mm²_Fase B", "50,0mm²_Fase C", "50,0mm²_Neutro", "50,0mm²_Terra"], "constante": 176.71},
    "70,0mm²": {"parametros": ["70,0mm²_Fase A", "70,0mm²_Fase B", "70,0mm²_Fase C", "70,0mm²_Neutro", "70,0mm²_Terra"], "constante": 219.03},
    "95,0mm²": {"parametros": ["95,0mm²_Fase A", "95,0mm²_Fase B", "95,0mm²_Fase C", "95,0mm²_Neutro", "95,0mm²_Terra"], "constante": 271.71},
    "120,0mm²": {"parametros": ["120,0mm²_Fase A", "120,0mm²_Fase B", "120,0mm²_Fase C", "120,0mm²_Neutro", "120,0mm²_Terra"], "constante": 336.53},
    "150,0mm²": {"parametros": ["150,0mm²_Fase A", "150,0mm²_Fase B", "150,0mm²_Fase C", "150,0mm²_Neutro", "150,0mm²_Terra"], "constante": 419.08},
    "185,0mm²": {"parametros": ["185,0mm²_Fase A", "185,0mm²_Fase B", "185,0mm²_Fase C", "185,0mm²_Neutro", "185,0mm²_Terra"], "constante": 490.86},
    "240,0mm²": {"parametros": ["240,0mm²_Fase A", "240,0mm²_Fase B", "240,0mm²_Fase C", "240,0mm²_Neutro", "240,0mm²_Terra"], "constante": 629},
    "cat6": {"parametros": ["CABO-UTP 4P", "Cb-UTP 4P"], "constante": 30.19}
}

# Coletando elementos da categoria Conduítes
categoria_conduite = BuiltInCategory.OST_Conduit
filtro_categoria = ElementCategoryFilter(categoria_conduite)
colecao_elementos = FilteredElementCollector(doc).WherePasses(filtro_categoria).WhereElementIsNotElementType().ToElements()

# Inicializando o formulário de barra de progresso
progress_form = ProgressBarForm(len(colecao_elementos))
progress_form.Show()

# Iniciando a transação
TransactionManager.Instance.EnsureInTransaction(doc)

# Processando cada elemento da coleção
for i, elemento in enumerate(colecao_elementos, start=1):
    soma_total_multiplicada = 0
    quantidade_por_grupo = {}

    # Iteração por cada tamanho
    for tamanho in ordem_tamanhos:
        info = parametros_por_tamanho.get(tamanho, None)
        if info:
            parametros = info["parametros"]
            constante = info["constante"]
            soma_tamanho = 0

            for nome_parametro in parametros:
                parametro = elemento.LookupParameter(nome_parametro)
                if parametro:
                    valor_parametro = parametro.AsDouble() or parametro.AsInteger() or 0
                    soma_tamanho += valor_parametro

            resultado_multiplicado = soma_tamanho * constante
            soma_total_multiplicada += resultado_multiplicado

            if soma_tamanho > 0:
                quantidade_por_grupo[tamanho] = soma_tamanho

    # Atribuições de parâmetros
    parametro_ocupacao = elemento.LookupParameter("Ocupação cabos")
    if parametro_ocupacao and parametro_ocupacao.AsDouble() != soma_total_multiplicada:
        parametro_ocupacao.Set(soma_total_multiplicada)

    descricao_ocupacao = "; ".join(["{} x {}".format(quantidade_por_grupo[tamanho], tamanho) for tamanho in ordem_tamanhos if tamanho in quantidade_por_grupo])

    parametro_descricao = elemento.LookupParameter("Descrição ocupação")
    if parametro_descricao and parametro_descricao.AsString() != descricao_ocupacao:
        parametro_descricao.Set(descricao_ocupacao)

    parametro_trecho = elemento.LookupParameter("Trecho")
    if parametro_trecho:
        parametro_trecho.Set(i)

    # Atualizar a barra de progresso
    progress_form.update_progress(i)

# Finalizando a transação
TransactionManager.Instance.TransactionTaskDone()
progress_form.update_progress(len(colecao_elementos))  # Garantindo que a barra chegue ao final
progress_form.Close()
# ----------------------------------------
# note: cabos bandeja
python_script_7 = Python()  # IronPython2; unwired: IN[0]
# ---------- python_script_7.python (148 lines) ----------
# Importando as bibliotecas necessárias
import clr
clr.AddReference("RevitServices")
from RevitServices.Persistence import DocumentManager
from RevitServices.Transactions import TransactionManager

clr.AddReference("RevitAPI")
from Autodesk.Revit.DB import FilteredElementCollector, BuiltInCategory, ElementCategoryFilter

# Adicionando referências para a interface gráfica
clr.AddReference("System.Windows.Forms")
clr.AddReference("System.Drawing")
from System.Windows.Forms import Form, ProgressBar, Label, Application, FormStartPosition
from System.Drawing import Color, Size, Point
import time

# Classe para a barra de progresso
class ProgressBarForm(Form):
    def __init__(self, max_value):
        self.Text = 'Processando Ocupação dos Cabos'
        self.Size = Size(300, 150)
        self.StartPosition = FormStartPosition.CenterScreen
        self.BackColor = Color.FromArgb(45, 45, 48)
        self.ForeColor = Color.White
        self.ShowIcon = False

        # Configuração da barra de progresso
        self.progressBar = ProgressBar()
        self.progressBar.Width = 250
        self.progressBar.Height = 30
        self.progressBar.Location = Point(20, 20)
        self.progressBar.Minimum = 0
        self.progressBar.Maximum = max_value
        self.progressBar.Value = 0

        # Configuração do rótulo
        self.progressLabel = Label()
        self.progressLabel.Width = 250
        self.progressLabel.Height = 20
        self.progressLabel.Location = Point(20, 60)
        self.progressLabel.Text = "Iniciando..."

        # Adiciona os controles ao formulário
        self.Controls.Add(self.progressBar)
        self.Controls.Add(self.progressLabel)

    def update_progress(self, value):
        # Garantir que o valor máximo seja atingido
        if value >= self.progressBar.Maximum:
            self.progressBar.Value = self.progressBar.Maximum
        else:
            self.progressBar.Value = value
        self.progressLabel.Text = "Processando elemento {}/{}".format(value, self.progressBar.Maximum)
        Application.DoEvents()

        if value == self.progressBar.Maximum:
            self.progressLabel.Text = "Finalizado com sucesso."
            time.sleep(1)

# Obtendo o documento ativo
doc = DocumentManager.Instance.CurrentDBDocument

# Lista de tamanhos em ordem fixa
ordem_tamanhos = ["1,5mm²", "2,5mm²", "4,0mm²", "6,0mm²", "10,0mm²", "16,0mm²", "25,0mm²", 
                  "35,0mm²", "50,0mm²", "70,0mm²", "95,0mm²", "120,0mm²", "150,0mm²", "185,0mm²", "240,0mm²"]

parametros_por_tamanho = {
    "1,5mm²": {"parametros": ["1,5mm²_Fase A", "1,5mm²_Fase B", "1,5mm²_Fase C", "1,5mm²_Neutro", "1,5mm²_Retorno", "1,5mm²_Terra"], "constante": 15.90 },
    "2,5mm²": {"parametros": ["2,5mm²_Fase A", "2,5mm²_Fase B", "2,5mm²_Fase C", "2,5mm²_Neutro", "2,5mm²_Retorno", "2,5mm²_Terra"], "constante": 21.23},
    "4,0mm²": {"parametros": ["4,0mm²_Fase A", "4,0mm²_Fase B", "4,0mm²_Fase C", "4,0mm²_Neutro", "4,0mm²_Retorno", "4,0mm²_Terra"], "constante": 23.75},
    "6,0mm²": {"parametros": ["6,0mm²_Fase A", "6,0mm²_Fase B", "6,0mm²_Fase C", "6,0mm²_Neutro", "6,0mm²_Terra"], "constante": 29.22},
    "10,0mm²": {"parametros": ["10,0mm²_Fase A", "10,0mm²_Fase B", "10,0mm²_Fase C", "10,0mm²_Neutro", "10,0mm²_Terra"], "constante": 45.36},
    "16,0mm²": {"parametros": ["16,0mm²_Fase A", "16,0mm²_Fase B", "16,0mm²_Fase C", "16,0mm²_Neutro", "16,0mm²_Terra"], "constante": 55.41},
    "25,0mm²": {"parametros": ["25,0mm²_Fase A", "25,0mm²_Fase B", "25,0mm²_Fase C", "25,0mm²_Neutro", "25,0mm²_Terra"], "constante": 83.32},
    "35,0mm²": {"parametros": ["35,0mm²_Fase A", "35,0mm²_Fase B", "35,0mm²_Fase C", "35,0mm²_Neutro", "35,0mm²_Terra"], "constante": 102.06},
    "50,0mm²": {"parametros": ["50,0mm²_Fase A", "50,0mm²_Fase B", "50,0mm²_Fase C", "50,0mm²_Neutro", "50,0mm²_Terra"], "constante": 138.92},
    "70,0mm²": {"parametros": ["70,0mm²_Fase A", "70,0mm²_Fase B", "70,0mm²_Fase C", "70,0mm²_Neutro", "70,0mm²_Terra"], "constante": 193.58},
    "95,0mm²": {"parametros": ["95,0mm²_Fase A", "95,0mm²_Fase B", "95,0mm²_Fase C", "95,0mm²_Neutro", "95,0mm²_Terra"], "constante": 243.27},
    "120,0mm²": {"parametros": ["120,0mm²_Fase A", "120,0mm²_Fase B", "120,0mm²_Fase C", "120,0mm²_Neutro", "120,0mm²_Terra"], "constante": 298.63},
    "150,0mm²": {"parametros": ["150,0mm²_Fase A", "150,0mm²_Fase B", "150,0mm²_Fase C", "150,0mm²_Neutro", "150,0mm²_Terra"], "constante": 373.24},
    "185,0mm²": {"parametros": ["185,0mm²_Fase A", "185,0mm²_Fase B", "185,0mm²_Fase C", "185,0mm²_Neutro", "185,0mm²_Terra"], "constante": 444.86},
    "240,0mm²": {"parametros": ["240,0mm²_Fase A", "240,0mm²_Fase B", "240,0mm²_Fase C", "240,0mm²_Neutro", "240,0mm²_Terra"], "constante": 564.08},
    "cat6": {"parametros": ["CABO-UTP 4P", "Cb-UTP 4P"], "constante": 30.19}
}

# Coletando elementos da categoria Bandeja de Cabos
categoria_bandeja = BuiltInCategory.OST_CableTray
filtro_categoria = ElementCategoryFilter(categoria_bandeja)
colecao_elementos = FilteredElementCollector(doc).WherePasses(filtro_categoria).WhereElementIsNotElementType().ToElements()

# Inicializando o formulário de barra de progresso
progress_form = ProgressBarForm(len(colecao_elementos))
progress_form.Show()

# Iniciando a transação
TransactionManager.Instance.EnsureInTransaction(doc)

# Processando cada elemento da coleção
for i, elemento in enumerate(colecao_elementos, start=1):
    soma_total_multiplicada = 0
    quantidade_por_grupo = {}

    # Iteração por cada tamanho
    for tamanho in ordem_tamanhos:
        info = parametros_por_tamanho.get(tamanho, None)
        if info:
            parametros = info["parametros"]
            constante = info["constante"]
            soma_tamanho = 0

            for nome_parametro in parametros:
                for parametro in elemento.Parameters:
                    if parametro is not None and parametro.Definition is not None:
                        if parametro.Definition.Name == nome_parametro:
                            valor_parametro = parametro.AsDouble() or parametro.AsInteger() or 0
                            soma_tamanho += valor_parametro
            
            resultado_multiplicado = soma_tamanho * constante
            soma_total_multiplicada += resultado_multiplicado

            if soma_tamanho > 0:
                quantidade_por_grupo[tamanho] = soma_tamanho

    # Atribuições de parâmetros
    parametro_ocupacao = elemento.LookupParameter("Ocupação cabos")
    if parametro_ocupacao and parametro_ocupacao.AsDouble() != soma_total_multiplicada:
        parametro_ocupacao.Set(soma_total_multiplicada)

    descricao_ocupacao = "; ".join(["{} x {}".format(quantidade_por_grupo[tamanho], tamanho) for tamanho in ordem_tamanhos if tamanho in quantidade_por_grupo])

    parametro_descricao = elemento.LookupParameter("Descrição ocupação")
    if parametro_descricao and parametro_descricao.AsString() != descricao_ocupacao:
        parametro_descricao.Set(descricao_ocupacao)

    parametro_trecho = elemento.LookupParameter("Trecho")
    if parametro_trecho:
        parametro_trecho.Set(i)

    # Atualizar a barra de progresso
    progress_form.update_progress(i)

# Finalizando a transação
TransactionManager.Instance.TransactionTaskDone()
progress_form.update_progress(len(colecao_elementos))  # Garantindo que a barra chegue ao final
progress_form.Close()

# Saída com a quantidade de cabos por grupo separada por elemento e organizada em ordem fixa, excluindo valores zero
OUT = quantidade_por_grupo
# ----------------------------------------
# note: cabos conduite
python_script_8 = Python()  # IronPython2; frozen; unwired: IN[0]
# ---------- python_script_8.python (144 lines) ----------
# Importando as bibliotecas necessárias
import clr
clr.AddReference("RevitServices")
from RevitServices.Persistence import DocumentManager
from RevitServices.Transactions import TransactionManager

clr.AddReference("RevitAPI")
from Autodesk.Revit.DB import FilteredElementCollector, BuiltInCategory, ElementCategoryFilter

# Adicionando referências para a interface gráfica
clr.AddReference("System.Windows.Forms")
clr.AddReference("System.Drawing")
from System.Windows.Forms import Form, ProgressBar, Label, Application, FormStartPosition
from System.Drawing import Color, Size, Point
import time

# Classe para a barra de progresso
class ProgressBarForm(Form):
    def __init__(self, max_value):
        self.Text = 'Processando Ocupação dos Cabos'
        self.Size = Size(370, 150)
        self.StartPosition = FormStartPosition.CenterScreen
        self.BackColor = Color.FromArgb(45, 45, 48)
        self.ForeColor = Color.White
        self.ShowIcon = False

        # Configuração da barra de progresso
        self.progressBar = ProgressBar()
        self.progressBar.Width = 300
        self.progressBar.Height = 30
        self.progressBar.Location = Point(20, 20)
        self.progressBar.Minimum = 0
        self.progressBar.Maximum = max_value
        self.progressBar.Value = 0

        # Configuração do rótulo
        self.progressLabel = Label()
        self.progressLabel.Width = 350
        self.progressLabel.Height = 20
        self.progressLabel.Location = Point(20, 60)
        self.progressLabel.Text = "Iniciando..."

        # Adiciona os controles ao formulário
        self.Controls.Add(self.progressBar)
        self.Controls.Add(self.progressLabel)

    def update_progress(self, value):
        # Ajuste para garantir que o valor final seja alcançado
        if value >= self.progressBar.Maximum:
            self.progressBar.Value = self.progressBar.Maximum
        else:
            self.progressBar.Value = value
        self.progressLabel.Text = "Ocupação do cabo {}/{}".format(value, self.progressBar.Maximum)
        Application.DoEvents()

        if value == self.progressBar.Maximum:
            self.progressLabel.Text = "Finalizado com sucesso."
            time.sleep(1)

# Obtendo o documento ativo
doc = DocumentManager.Instance.CurrentDBDocument

# Lista de tamanhos e parâmetros de acordo com o exemplo
ordem_tamanhos = ["1,5mm²", "2,5mm²", "4,0mm²", "6,0mm²", "10,0mm²", "16,0mm²", "25,0mm²", 
                  "35,0mm²", "50,0mm²", "70,0mm²", "95,0mm²", "120,0mm²", "150,0mm²", "185,0mm²", "240,0mm²","cat6"]

parametros_por_tamanho = {
    "1,5mm²": {"parametros": ["1,5mm²_Fase A", "1,5mm²_Fase B", "1,5mm²_Fase C", "1,5mm²_Neutro", "1,5mm²_Retorno", "1,5mm²_Terra"], "constante": 15.90 },
    "2,5mm²": {"parametros": ["2,5mm²_Fase A", "2,5mm²_Fase B", "2,5mm²_Fase C", "2,5mm²_Neutro", "2,5mm²_Retorno", "2,5mm²_Terra"], "constante": 21.23},
    "4,0mm²": {"parametros": ["4,0mm²_Fase A", "4,0mm²_Fase B", "4,0mm²_Fase C", "4,0mm²_Neutro", "4,0mm²_Retorno", "4,0mm²_Terra"], "constante": 23.75},
    "6,0mm²": {"parametros": ["6,0mm²_Fase A", "6,0mm²_Fase B", "6,0mm²_Fase C", "6,0mm²_Neutro", "6,0mm²_Terra"], "constante": 29.22},
    "10,0mm²": {"parametros": ["10,0mm²_Fase A", "10,0mm²_Fase B", "10,0mm²_Fase C", "10,0mm²_Neutro", "10,0mm²_Terra"], "constante": 45.36},
    "16,0mm²": {"parametros": ["16,0mm²_Fase A", "16,0mm²_Fase B", "16,0mm²_Fase C", "16,0mm²_Neutro", "16,0mm²_Terra"], "constante": 55.41},
    "25,0mm²": {"parametros": ["25,0mm²_Fase A", "25,0mm²_Fase B", "25,0mm²_Fase C", "25,0mm²_Neutro", "25,0mm²_Terra"], "constante": 83.32},
    "35,0mm²": {"parametros": ["35,0mm²_Fase A", "35,0mm²_Fase B", "35,0mm²_Fase C", "35,0mm²_Neutro", "35,0mm²_Terra"], "constante": 102.06},
    "50,0mm²": {"parametros": ["50,0mm²_Fase A", "50,0mm²_Fase B", "50,0mm²_Fase C", "50,0mm²_Neutro", "50,0mm²_Terra"], "constante": 138.92},
    "70,0mm²": {"parametros": ["70,0mm²_Fase A", "70,0mm²_Fase B", "70,0mm²_Fase C", "70,0mm²_Neutro", "70,0mm²_Terra"], "constante": 193.58},
    "95,0mm²": {"parametros": ["95,0mm²_Fase A", "95,0mm²_Fase B", "95,0mm²_Fase C", "95,0mm²_Neutro", "95,0mm²_Terra"], "constante": 243.27},
    "120,0mm²": {"parametros": ["120,0mm²_Fase A", "120,0mm²_Fase B", "120,0mm²_Fase C", "120,0mm²_Neutro", "120,0mm²_Terra"], "constante": 298.63},
    "150,0mm²": {"parametros": ["150,0mm²_Fase A", "150,0mm²_Fase B", "150,0mm²_Fase C", "150,0mm²_Neutro", "150,0mm²_Terra"], "constante": 373.24},
    "185,0mm²": {"parametros": ["185,0mm²_Fase A", "185,0mm²_Fase B", "185,0mm²_Fase C", "185,0mm²_Neutro", "185,0mm²_Terra"], "constante": 444.86},
    "240,0mm²": {"parametros": ["240,0mm²_Fase A", "240,0mm²_Fase B", "240,0mm²_Fase C", "240,0mm²_Neutro", "240,0mm²_Terra"], "constante": 564.08},
    "cat6": {"parametros": ["CABO-UTP 4P", "Cb-UTP 4P"], "constante": 30.19}
}

# Coletando elementos da categoria Conduítes
categoria_conduite = BuiltInCategory.OST_Conduit
filtro_categoria = ElementCategoryFilter(categoria_conduite)
colecao_elementos = FilteredElementCollector(doc).WherePasses(filtro_categoria).WhereElementIsNotElementType().ToElements()

# Inicializando o formulário de barra de progresso
progress_form = ProgressBarForm(len(colecao_elementos))
progress_form.Show()

# Iniciando a transação
TransactionManager.Instance.EnsureInTransaction(doc)

# Processando cada elemento da coleção
for i, elemento in enumerate(colecao_elementos, start=1):
    soma_total_multiplicada = 0
    quantidade_por_grupo = {}

    # Iteração por cada tamanho
    for tamanho in ordem_tamanhos:
        info = parametros_por_tamanho.get(tamanho, None)
        if info:
            parametros = info["parametros"]
            constante = info["constante"]
            soma_tamanho = 0

            for nome_parametro in parametros:
                parametro = elemento.LookupParameter(nome_parametro)
                if parametro:
                    valor_parametro = parametro.AsDouble() or parametro.AsInteger() or 0
                    soma_tamanho += valor_parametro

            resultado_multiplicado = soma_tamanho * constante
            soma_total_multiplicada += resultado_multiplicado

            if soma_tamanho > 0:
                quantidade_por_grupo[tamanho] = soma_tamanho

    # Atribuições de parâmetros
    parametro_ocupacao = elemento.LookupParameter("Ocupação cabos")
    if parametro_ocupacao and parametro_ocupacao.AsDouble() != soma_total_multiplicada:
        parametro_ocupacao.Set(soma_total_multiplicada)

    descricao_ocupacao = "; ".join(["{} x {}".format(quantidade_por_grupo[tamanho], tamanho) for tamanho in ordem_tamanhos if tamanho in quantidade_por_grupo])

    parametro_descricao = elemento.LookupParameter("Descrição ocupação")
    if parametro_descricao and parametro_descricao.AsString() != descricao_ocupacao:
        parametro_descricao.Set(descricao_ocupacao)

    parametro_trecho = elemento.LookupParameter("Trecho")
    if parametro_trecho:
        parametro_trecho.Set(i)

    # Atualizar a barra de progresso
    progress_form.update_progress(i)

# Finalizando a transação
TransactionManager.Instance.TransactionTaskDone()
progress_form.update_progress(len(colecao_elementos))  # Garantindo que a barra chegue ao final
progress_form.Close()
# ----------------------------------------
